# Dynamo graph Creating door types.dyn (Dynamo 2.6.1.8786)
# packages: Clockwork for Dynamo 1.x 1.34.0

file_path = Filename(".\Family sizes.xlsx")
file_from_path = FileObject(path=file_path)

# group: Door
family_types = FamilyTypes("Doors_IntSgl:1010x2110mm")
string = StringInput("door")
importExcel = Data.ImportExcel(file=file_from_path, sheetName=string)
code_block = CodeBlock { 1; }
dropItems = List.DropItems(list=importExcel, amount=code_block)
transpose = List.Transpose(lists=dropItems)
code_block_2 = CodeBlock { 0; 1; 2; }
getItemAtIndex = List.GetItemAtIndex(list=transpose, index=code_block_2.out2)
duplicate = Custom[FamilyType.Duplicate](elementType=family_types, name=getItemAtIndex, lacing=Longest)  # package Clockwork for Dynamo 1.x; Duplicates a family type
code_block_3 = CodeBlock { "Width"; "Height"; }
getItemAtIndex_2 = List.GetItemAtIndex(list=transpose, index=code_block_2.out0)
setParameterByName = Element.SetParameterByName(element=duplicate, parameterName=code_block_3.out0, value=getItemAtIndex_2)
getItemAtIndex_3 = List.GetItemAtIndex(list=transpose, index=code_block_2.out1)
setParameterByName_2 = Element.SetParameterByName(element=duplicate, parameterName=code_block_3.out1, value=getItemAtIndex_3)
watch = Watch(getItemAtIndex_2)
watch_2 = Watch(getItemAtIndex_3)
watch_3 = Watch(getItemAtIndex)
