# Dynamo graph Creating wall types.dyn "Wall types" (Dynamo 2.6.1.8786)
# packages: Orchid 2.6.7.6006, Genius Loci 2021.11.10

wall_types = WallTypes("Wall-Ret_300Con")
file_path = Filename("..\..\github upload\Family sizes.xlsx")
file_from_path = FileObject(path=file_path)
string = StringInput("wall")
importExcel = Data.ImportExcel(file=file_from_path, sheetName=string)
code_block = CodeBlock { 1; }
dropItems = List.DropItems(list=importExcel, amount=code_block)
transpose = List.Transpose(lists=dropItems)
code_block_2 = CodeBlock { 0; 1; }
getItemAtIndex = List.GetItemAtIndex(list=transpose, index=code_block_2.out0)
element_duplicate = Custom[Element Duplicate](element=wall_types, name=getItemAtIndex)  # package Genius Loci; Duplicates the given element (view, element type).
getItemAtIndex_2 = List.GetItemAtIndex(list=transpose, index=code_block_2.out1)
code_block_3 = CodeBlock { 0; }
o_systemfamilytype = Orchid.RevitProject.Elements.SystemFamilyType.SetCompoundLayerWidth(elementType=element_duplicate, thickness=getItemAtIndex_2, index=code_block_3, lacing=Longest)
