# Dynamo graph Creating window types.dyn (Dynamo 2.6.1.8786)
# packages: Clockwork for Dynamo 1.x 1.34.0

file_path = Filename(".\Family sizes.xlsx")
file_from_path = FileObject(path=file_path)

# group: Window
string = StringInput("window")
importExcel = Data.ImportExcel(file=file_from_path, sheetName=string)
code_block = CodeBlock { 1; }
dropItems = List.DropItems(list=importExcel, amount=code_block)
transpose = List.Transpose(lists=dropItems)
code_block_2 = CodeBlock { 0; 1; 2; }
getItemAtIndex = List.GetItemAtIndex(list=transpose, index=code_block_2.out0)
watch = Watch(getItemAtIndex)
getItemAtIndex_2 = List.GetItemAtIndex(list=transpose, index=code_block_2.out1)
watch_2 = Watch(getItemAtIndex_2)
getItemAtIndex_3 = List.GetItemAtIndex(list=transpose, index=code_block_2.out2)
watch_3 = Watch(getItemAtIndex_3)
family_types = FamilyTypes("Windows_Sgl_Plain:1360x1210mm")
duplicate = Custom[FamilyType.Duplicate](elementType=family_types, name=getItemAtIndex_3, lacing=Longest)  # package Clockwork for Dynamo 1.x; Duplicates a family type
code_block_3 = CodeBlock { "Width"; "Height"; }
setParameterByName = Element.SetParameterByName(element=duplicate, parameterName=code_block_3.out0, value=getItemAtIndex)
setParameterByName_2 = Element.SetParameterByName(element=duplicate, parameterName=code_block_3.out1, value=getItemAtIndex_2)
