# Dynamo graph generating 3d column_script.dyn (Dynamo 2.10.1.3976)
# packages: Data-Shapes 2022.2.103, Clockwork for Dynamo 1.x 1.34.0

code_block = CodeBlock {  }

# group: Column
file_path = Filename(".\Input Data.xlsx")  # graph input
string = StringInput("column")
code_block_2 = CodeBlock { 1; }
code_block_3 = CodeBlock { 0; 1; 2; 3; 4; 5; 6; 7; 8; 9; 10; }

filepath_data = Custom[FilePath Data](DefaulPath=file_path)  # package Data-Shapes; Create filepath input for UI.MultipleInputForm ++ . Check out www.data-shapes.net for more infos !
boolean = BoolSelector(true)
multipleinputform = Custom[MultipleInputForm ++](Inputs=filepath_data, Toggle=boolean)  # package Data-Shapes; Create a form with multiple inputs. see www.data-shapes.net for tutorials and infos!
file_from_path = FileObject(path=multipleinputform.User_Inputs)

# group (continued): Column
importExcel = Data.ImportExcel(file=file_from_path, sheetName=string)

equalSublistLengths = Custom[List.EqualSublistLengths](lists=importExcel)  # package Clockwork for Dynamo 1.x; Trims all given lists to the length of the shortest list

# group (continued): Column
dropItems = List.DropItems(list=equalSublistLengths, amount=code_block_2)
transpose = List.Transpose(lists=dropItems)
getItemAtIndex = List.GetItemAtIndex(list=transpose, index=code_block_3.out0)
getItemAtIndex_2 = List.GetItemAtIndex(list=transpose, index=code_block_3.out1)
getItemAtIndex_3 = List.GetItemAtIndex(list=transpose, index=code_block_3.out4)
byCoordinates = Point.ByCoordinates(x=getItemAtIndex, y=getItemAtIndex_2, z=getItemAtIndex_3)
getItemAtIndex_4 = List.GetItemAtIndex(list=transpose, index=code_block_3.out5)
byCoordinates_2 = Point.ByCoordinates(x=getItemAtIndex, y=getItemAtIndex_2, z=getItemAtIndex_4)
byStartPointEndPoint = Line.ByStartPointEndPoint(startPoint=byCoordinates, endPoint=byCoordinates_2)
getItemAtIndex_5 = List.GetItemAtIndex(list=transpose, index=code_block_3.out3)
byElevationAndName = Level.ByElevationAndName(elevation=getItemAtIndex_3, name=getItemAtIndex_5)
getItemAtIndex_6 = List.GetItemAtIndex(list=transpose, index=code_block_3.out8)
string_from_object = FromObject(obj=getItemAtIndex_6)
byName = FamilyType.ByName(name=string_from_object)
columnByCurve = StructuralFraming.ColumnByCurve(curve=byStartPointEndPoint, level=byElevationAndName, structuralColumnType=byName)
