# Dynamo graph generating 3d windows_script.dyn (Dynamo 2.10.1.3976)
# packages: spring nodes 204.1.0, spring nodes 210.1.1, Clockwork for Dynamo 1.x 1.34.0, Data-Shapes 2022.2.103

code_block = CodeBlock {  }
element_types = ElementTypes("Wall")
all_elements_of_type = ElementsOfType(element_type=element_types)
transpose = List.Transpose(lists=all_elements_of_type, lacing=Longest)
file_path = Filename(".\Input Data.xlsx")  # graph input
filepath_data = Custom[FilePath Data](DefaulPath=file_path)  # package Data-Shapes; Create filepath input for UI.MultipleInputForm ++ . Check out www.data-shapes.net for more infos !
boolean = BoolSelector(true)
multipleinputform = Custom[MultipleInputForm ++](Inputs=filepath_data, Toggle=boolean)  # package Data-Shapes; Create a form with multiple inputs. see www.data-shapes.net for tutorials and infos!
file_from_path = FileObject(path=multipleinputform.User_Inputs)

# group: Doors
string = StringInput("window")
importExcel = Data.ImportExcel(file=file_from_path, sheetName=string)
code_block_2 = CodeBlock { 1; }

equalSublistLengths = Custom[List.EqualSublistLengths](lists=importExcel)  # package Clockwork for Dynamo 1.x; Trims all given lists to the length of the shortest list

# group (continued): Doors
dropItems = List.DropItems(list=equalSublistLengths, amount=code_block_2)
transpose_2 = List.Transpose(lists=dropItems)

code_block_3 = CodeBlock(a=transpose_2)
# ---------- code_block_3.designscript (20 lines) ----------
List.GetItemAtIndex(a[],0);
List.GetItemAtIndex(a[],1);
List.GetItemAtIndex(a[],2);
List.GetItemAtIndex(a[],3);
List.GetItemAtIndex(a[],4);
List.GetItemAtIndex(a[],5);
List.GetItemAtIndex(a[],6);
List.GetItemAtIndex(a[],7);
List.GetItemAtIndex(a[],8);
List.GetItemAtIndex(a[],9);
List.GetItemAtIndex(a[],10);
List.GetItemAtIndex(a[],11);
List.GetItemAtIndex(a[],12);
List.GetItemAtIndex(a[],13);
List.GetItemAtIndex(a[],14);
List.GetItemAtIndex(a[],15);
List.GetItemAtIndex(a[],16);
List.GetItemAtIndex(a[],17);
List.GetItemAtIndex(a[],18);
List.GetItemAtIndex(a[],19);
# ----------------------------------------
string_from_object = FromObject(obj=code_block_3.out9)
byName = FamilyType.ByName(name=string_from_object)
byCoordinates = Point.ByCoordinates(x=code_block_3.out5, y=code_block_3.out6, z=code_block_3.out7)
ꟿ_familyinstance_byhostandpoint = Custom[ꟿ FamilyInstance.ByHostAndPoint](host=all_elements_of_type, type=byName, point=byCoordinates)  # package spring nodes; Creates hosted family instances(doors/windows) at the specified points. You can feed either a single family type or a unique type for each instance.

# group (continued): Doors
string_from_object_2 = FromObject(obj=code_block_3.out4)
byName_2 = FamilyType.ByName(name=string_from_object_2)
byCoordinates_2 = Point.ByCoordinates(x=code_block_3.out0, y=code_block_3.out1, z=code_block_3.out2)
ꟿ_familyinstance_byhostandpoint_2 = Custom[ꟿ FamilyInstance.ByHostAndPoint](host=all_elements_of_type, type=byName_2, point=byCoordinates_2)

string_from_object_3 = FromObject(object=code_block_3.out14)
byName_3 = FamilyType.ByName(name=string_from_object_3)
byCoordinates_3 = Point.ByCoordinates(x=code_block_3.out10, y=code_block_3.out11, z=code_block_3.out12)
ꟿ_familyinstance_byhostandpoint_3 = Custom[ꟿ FamilyInstance.ByHostAndPoint](host=all_elements_of_type, type=byName_3, point=byCoordinates_3)
