# Dynamo graph Creating Grids_script.dyn (Dynamo 2.10.1.3976)
# packages: Clockwork for Dynamo 1.x 1.34.0, WombatDynamo 2.3.5

# group: Grids
element_types = ElementTypes("Wall")
all_elements_of_type = ElementsOfType(element_type=element_types)
orientation = Custom[Wall.Orientation](wall=all_elements_of_type)  # package Clockwork for Dynamo 1.x; Gets the orientation of a given wall instance (normal of the exterior face of the wall). Will *not* work for walls hosted on mass faces or in-place walls.
X = Vector.X(vector=orientation)
code_block = CodeBlock(x=X) { x==0; }
filterByBoolMask = List.FilterByBoolMask(list=all_elements_of_type, mask=code_block)
getLocation = Element.GetLocation(element=filterByBoolMask.out)
string = StringInput("Name")
grid_start_character = StringInput("A")
getLocation_2 = Element.GetLocation(element=filterByBoolMask.in)
grid_start_number = DoubleInput(1)

startPoint = Curve.StartPoint(curve=getLocation)
deconstruct = WombatDynamo.Point.Deconstruct(point=startPoint)
code_block_2 = CodeBlock { 0; }
getItemAtIndex = List.GetItemAtIndex(list=startPoint, index=code_block_2)
deconstruct_2 = WombatDynamo.Point.Deconstruct(point=getItemAtIndex)
byCoordinates = Point.ByCoordinates(x=deconstruct.X, y=deconstruct_2.Y, z=deconstruct.Z)
endPoint = Curve.EndPoint(curve=getLocation)
byStartPointEndPoint = Line.ByStartPointEndPoint(startPoint=byCoordinates, endPoint=endPoint)

# group (continued): Grids
byLine = Grid.ByLine(line=byStartPointEndPoint)
count = List.Count(list=byLine)
code_block_3 = CodeBlock(start_character=grid_start_character, total=count) { start_character..#total..1; }
string_from_object = FromObject(object=code_block_3)
setParameterByName = Element.SetParameterByName(element=byLine, parameterName=string, value=string_from_object)

startPoint_2 = Curve.StartPoint(curve=getLocation_2)
code_block_4 = CodeBlock { 0; }
getItemAtIndex_2 = List.GetItemAtIndex(list=startPoint_2, index=code_block_4)
deconstruct_3 = WombatDynamo.Point.Deconstruct(point=getItemAtIndex_2)
deconstruct_4 = WombatDynamo.Point.Deconstruct(point=startPoint_2)
byCoordinates_2 = Point.ByCoordinates(x=deconstruct_3.X, y=deconstruct_4.Y, z=deconstruct_4.Z)
endPoint_2 = Curve.EndPoint(curve=getLocation_2)
byStartPointEndPoint_2 = Line.ByStartPointEndPoint(startPoint=byCoordinates_2, endPoint=endPoint_2)

# group (continued): Grids
byLine_2 = Grid.ByLine(line=byStartPointEndPoint_2)
count_2 = List.Count(list=byLine_2)
code_block_5 = CodeBlock(start_number=grid_start_number, total=count_2) { start_number..#total..1; }
string_from_object_2 = FromObject(object=code_block_5)
setParameterByName_2 = Element.SetParameterByName(element=byLine_2, parameterName=string, value=string_from_object_2)
