# Dynamo graph generating 3d column.dyn (Dynamo 2.6.1.8786)

code_block = CodeBlock {  }

# group: Column
file_path = Filename(".\Input Data.xlsx")
string = StringInput("column")
code_block_2 = CodeBlock { 1; }
code_block_3 = CodeBlock { 0; 1; 2; 3; 4; 5; 6; 7; 8; 9; 10; }

file_from_path = FileObject(path=file_path)

# group (continued): Column
importExcel = Data.ImportExcel(file=file_from_path, sheetName=string)
dropItems = List.DropItems(list=importExcel, amount=code_block_2)
transpose = List.Transpose(lists=dropItems)
getItemAtIndex = List.GetItemAtIndex(list=transpose, index=code_block_3.out0)
getItemAtIndex_2 = List.GetItemAtIndex(list=transpose, index=code_block_3.out1)
getItemAtIndex_3 = List.GetItemAtIndex(list=transpose, index=code_block_3.out4)
byCoordinates = Point.ByCoordinates(x=getItemAtIndex, y=getItemAtIndex_2, z=getItemAtIndex_3)
getItemAtIndex_4 = List.GetItemAtIndex(list=transpose, index=code_block_3.out5)
byCoordinates_2 = Point.ByCoordinates(x=getItemAtIndex, y=getItemAtIndex_2, z=getItemAtIndex_4)
byStartPointEndPoint = Line.ByStartPointEndPoint(startPoint=byCoordinates, endPoint=byCoordinates_2)
getItemAtIndex_5 = List.GetItemAtIndex(list=transpose, index=code_block_3.out3)
byElevationAndName = Level.ByElevationAndName(elevation=getItemAtIndex_3, name=getItemAtIndex_5)
getItemAtIndex_6 = List.GetItemAtIndex(list=transpose, index=code_block_3.out8)
string_from_object = FromObject(obj=getItemAtIndex_6)
byName = FamilyType.ByName(name=string_from_object)
columnByCurve = StructuralFraming.ColumnByCurve(curve=byStartPointEndPoint, level=byElevationAndName, structuralColumnType=byName)
