# Dynamo graph generating 3d walls.dyn (Dynamo 2.6.1.8786)

# group: Wall
file_path = Filename(".\Input Data.xlsx")
file_from_path = FileObject(path=file_path)
string = StringInput("wall")
importExcel = Data.ImportExcel(file=file_from_path, sheetName=string)
code_block = CodeBlock { 1; }
dropItems = List.DropItems(list=importExcel, amount=code_block)
transpose = List.Transpose(lists=dropItems)
code_block_2 = CodeBlock { 0; 1; 2; 3; 4; 5; 6; 7; 8; 9; 10; }
getItemAtIndex = List.GetItemAtIndex(list=transpose, index=code_block_2.out0)
getItemAtIndex_2 = List.GetItemAtIndex(list=transpose, index=code_block_2.out1)
byCoordinates = Point.ByCoordinates(x=getItemAtIndex, y=getItemAtIndex_2)
getItemAtIndex_3 = List.GetItemAtIndex(list=transpose, index=code_block_2.out2)
getItemAtIndex_4 = List.GetItemAtIndex(list=transpose, index=code_block_2.out3)
byCoordinates_2 = Point.ByCoordinates(x=getItemAtIndex_3, y=getItemAtIndex_4)
byStartPointEndPoint = Line.ByStartPointEndPoint(startPoint=byCoordinates, endPoint=byCoordinates_2)
getItemAtIndex_5 = List.GetItemAtIndex(list=transpose, index=code_block_2.out4)
getItemAtIndex_6 = List.GetItemAtIndex(list=transpose, index=code_block_2.out7)
getItemAtIndex_7 = List.GetItemAtIndex(list=transpose, index=code_block_2.out5)
byElevationAndName = Level.ByElevationAndName(elevation=getItemAtIndex_6, name=getItemAtIndex_7)
getItemAtIndex_8 = List.GetItemAtIndex(list=transpose, index=code_block_2.out6)
string_from_object = FromObject(object=getItemAtIndex_8)
byName = WallType.ByName(name=string_from_object)
byCurveAndHeight = Wall.ByCurveAndHeight(curve=byStartPointEndPoint, height=getItemAtIndex_5, level=byElevationAndName, wallType=byName)

code_block_3 = CodeBlock {  }
