# Dynamo graph generating 3d windows.dyn (Dynamo 2.6.1.8786)
# packages: spring nodes 210.1.1

file_path = Filename(".\Input Data.xlsx")
file_from_path = FileObject(path=file_path)
code_block = CodeBlock {  }
element_types = ElementTypes("Wall")
all_elements_of_type = ElementsOfType(element_type=element_types)

# group: Windows
string = StringInput("window")
importExcel = Data.ImportExcel(file=file_from_path, sheetName=string)
code_block_2 = CodeBlock { 1; }
dropItems = List.DropItems(list=importExcel, amount=code_block_2)
transpose = List.Transpose(lists=dropItems)
code_block_3 = CodeBlock { 0; 1; 2; 3; 4; 5; 6; 7; 8; 9; 10; }
getItemAtIndex = List.GetItemAtIndex(list=transpose, index=code_block_3.out3)
getItemAtIndex_2 = List.GetItemAtIndex(list=transpose, index=code_block_3.out4)
string_from_object = FromObject(object=getItemAtIndex_2)
byName = FamilyType.ByName(name=string_from_object)
getItemAtIndex_3 = List.GetItemAtIndex(list=transpose, index=code_block_3.out0)
getItemAtIndex_4 = List.GetItemAtIndex(list=transpose, index=code_block_3.out1)
getItemAtIndex_5 = List.GetItemAtIndex(list=transpose, index=code_block_3.out2)
byCoordinates = Point.ByCoordinates(x=getItemAtIndex_3, y=getItemAtIndex_4, z=getItemAtIndex_5)
ꟿ_familyinstance_byhostandpoint = Custom[ꟿ FamilyInstance.ByHostAndPoint](host=all_elements_of_type, type=byName, point=byCoordinates)  # package spring nodes; Creates hosted family instances(doors/windows) at the specified points. You can feed either a single family type or a unique type for each instance.
